# Grasshopper definition bedrooms_layout_optimizer_visualization.gh (Grasshopper 1.0.7)

# ----
# Furniture
bed = Curve(<curve referenced from the Rhino model>)
lounge = Curve(<curve referenced from the Rhino model>)
desk = Curve(<curve referenced from the Rhino model>)

# ----
# Room
floor = Curve(<curve referenced from the Rhino model>)
door_buffer = Curve(<curve referenced from the Rhino model>)
win = Curve([<curve referenced from the Rhino model> x2])
door = Curve(<curve referenced from the Rhino model>)

# ----
# Floor plan subdivision &
# Set horizontal frames
panel = Panel("60")
divlength_hframes = GhPythonScript(i_curve=floor, i_length=panel)  # -> out, o_frames; inputs i_curve: Curve
# ---------- divlength_hframes: Python ----------
import Rhino.Geometry as rh
import math


# Functions
def explode(curve):
    segments = curve.DuplicateSegments()
    return segments

def div_equi_length(segments, length):
    segments_parameters = []
    divisors = []
    for seg in segments:
         divisors.append(round(seg.GetLength() / length))
    for i, seg in enumerate(segments):
        parameters = seg.DivideByCount(divisors[i], True)
        segments_parameters.append(parameters)
    return segments_parameters

def get_horizontal_frame(segments, parameters):
    horizontal_frames = []
    for i, seg in enumerate(segments):
        for t in parameters[i]:
            plane_x = rh.Vector3d(seg.TangentAt(t).X, seg.TangentAt(t).Y, 0)
            plane_x.Unitize()
            plane_y = rh.Vector3d(seg.TangentAt(t).X, seg.TangentAt(t).Y, 0)
            plane_y.Rotate(math.pi * 0.5, rh.Vector3d.ZAxis)
            plane_y.Unitize()
            h_frame = rh.Plane(seg.PointAt(t), plane_x, plane_y)
            horizontal_frames.append(h_frame)
    return horizontal_frames


# Subdivide floor plan and set horizontal frames
segments = explode(i_curve)
segments_parameters = div_equi_length(segments, i_length)
horizontal_frames = get_horizontal_frame(segments, segments_parameters)


# Outputs
o_frames = horizontal_frames
# ---------- end divlength_hframes ----------

# ----
# Define Furnitrue Instances &
# Iterate Furniture Combinations
panel_2 = Panel("30")
furniture_instances = GhPythonScript(
    i_targets=divlength_hframes.o_frames,
    i_wins=win,
    i_doors=door,
    i_bed=bed,
    i_bed_buffer="30",
    i_lounge=lounge,
    i_lounge_buffer=panel_2,
    i_desk=desk,
    i_desk_buffer="35")  # -> out, o_furniture, o_bed_anchors, o_lounge_anchors, o_desk_anchors; inputs i_targets: list of Plane, i_wins: list of Curve, i_doors: list of Curve, i_bed: Curve, i_lounge: Curve, i_desk: Curve
# ---------- furniture_instances: Python ----------
import Rhino.RhinoDoc
import Rhino.Geometry as rh
import math
tol = Rhino.RhinoDoc.ActiveDoc.ModelAbsoluteTolerance

# Functions
def get_vertices(curve):
    vertices = []
    segments = curve.DuplicateSegments()
    for seg in segments:
        vertices.append(seg.PointAtStart)
    return vertices

def shortest_length(curve):
    segments = curve.DuplicateSegments()
    shortest = segments[0].GetLength()
    for i in range(1, len(segments)):
        length = segments[i].GetLength()
        if  shortest > length:
            shortest = length
    return shortest
    
def get_middle(curve):
    return curve.PointAtLength(curve.GetLength() / 2)
    
def get_horizontal_frame(curve, t):
    plane_x = rh.Vector3d(curve.TangentAt(t).X, curve.TangentAt(t).Y, 0)
    plane_x.Unitize()
    plane_y = rh.Vector3d(curve.TangentAt(t).X, curve.TangentAt(t).Y, 0)
    plane_y.Rotate(math.pi * 0.5, rh.Vector3d.ZAxis)
    plane_y.Unitize()
    horizontal_frame = rh.Plane(curve.PointAt(t), plane_x, plane_y)
    return horizontal_frame
    
def get_anchors(curve, left, top):
    segments = curve.DuplicateSegments()
    anchors = []
    if left:
        seg_left = segments[0]
        for seg in segments:
            if get_middle(seg_left).X > get_middle(seg).X:
                seg_left = seg
        anchors.append(get_horizontal_frame(seg_left, seg_left.Domain.Mid))
        
    if top:
        seg_top = segments[0]
        for seg in segments:
            if get_middle(seg_top).Y < get_middle(seg).Y:
                seg_top = seg
        anchors.append(get_horizontal_frame(seg_top, seg_top.Domain.Mid))
        
    return anchors
    
def get_buffer(curve, both_sides):
    buffer = []
    shortest = shortest_length(curve)
    pts = get_vertices(curve)
    n = len(pts)
    for i in range(n):
        dist = pts[i].DistanceTo(pts[(i+1) % n])
        if abs(dist - shortest) > tol: # for long sides of rectangles
            vec = pts[(i+1) % n] - pts[(i+2) % n]
            vec.Unitize()
            translate = vec * i_bed_buffer
            buffer_pts = [pts[i], pts[(i+1) % n], pts[(i+1) % n] + translate, pts[i] + translate]
            curve = rh.NurbsCurve.Create(True, 1, buffer_pts)
            buffer.append(curve)
            if not both_sides: break
    return buffer    
    
def orient(geometry, source, target):
    xform = rh.Transform.PlaneToPlane(source, target)
    geometry.Transform(xform)
    
def remap(value, source, target):
    normal_value = (value - source.T0) / source.Length
    new_value = (target.T0 + normal_value) * target.Length
    return new_value

 # get maximum distance between furniture and objs, and store the dist to furniture instances 
def set_dist_to_objects(objects, furnitures, is_window):
    centroid_objects = []
    for obj in objects:
        amp = rh.AreaMassProperties.Compute(obj)
        centroid_objects.append(amp.Centroid)
    dist_max = []
    for _ in range(len(objects)):
        dist_max.append(0)
    for furniture in furnitures:
        amp = rh.AreaMassProperties.Compute(furniture.body)
        centroid_fur = amp.Centroid
        for i, centroid_obj in enumerate(centroid_objects):
            dist = centroid_fur.DistanceTo(centroid_obj)
            if is_window: furniture.dist_to_window.append(dist)
            else: furniture.dist_to_door.append(dist)
            if dist_max[i] < dist: dist_max[i] = dist
    return dist_max
    
def set_furniture_score(objects, furnitures, dist_max, is_daylight, is_privacy):
    max_score = 100 / len(objects)
    interval_dist = []
    interval_dist_reverse = []
    interval_score = rh.Interval(0, max_score)
    for i in range(len(objects)):
        interval_dist.append(rh.Interval(0, dist_max[i]))
        interval_dist_reverse.append(rh.Interval(dist_max[i], 0))
        
    # Bed: Longer distance from window -> Higher Daylight score
    # Lounge: Shorter distance from the window -> Higher Daylight score
    # Desk: Shorter distance from the window -> Higher Daylight score
    if is_daylight:
        for furniture in furnitures:
            daylight_score = 0
            for i, dist in enumerate(furniture.dist_to_window):
                if furniture.name == 'bed':
                    daylight_score += remap(dist, interval_dist[i], interval_score)
                elif furniture.name == 'desk' or furniture.name == 'lounge':
                    daylight_score += remap(dist, interval_dist_reverse[i], interval_score)
            furniture.daylight_score = daylight_score
            
    # Bed: Longer distance from door --> Higher Privacy score
    # Lounge: Shorter distance from the door -> Higher Privacy score
    # Desk: Longer distance from the door -> Higher Privacy score
    if is_privacy:
        for furniture in furnitures:
            privacy_score = 0
            for i, dist in enumerate(furniture.dist_to_door):
                if furniture.name == 'bed' or furniture.name == 'desk':
                    privacy_score += remap(dist, interval_dist[i], interval_score)
                elif furniture.name == 'lounge':
                    privacy_score += remap(dist, interval_dist_reverse[i], interval_score)
            furniture.privacy_score = privacy_score

# Define furniture classes
class Bed:
    name = 'bed'
    def __init__(self, body, source, target):
        self.body = body.Duplicate()
        orient(self.body, source, target)
        self.buffer = get_buffer(self.body, True)
        self.daylight_score = None
        self.privacy_score = None
        self.dist_to_window = []
        self.dist_to_door = []
        self.anchor = target
    
class Lounge:
    name = 'lounge'
    def __init__(self, body, source, target):
        self.body = body.Duplicate()
        orient(self.body, source, target)
        self.buffer = get_buffer(self.body, True)
        self.daylight_score = None
        self.privacy_score = None
        self.dist_to_window = []
        self.dist_to_door = []
        self.anchor = target
        
class Desk:
    name = 'desk'
    def __init__(self, body, source, target):
        self.body = body.Duplicate()
        orient(self.body, source, target)
        self.buffer = get_buffer(self.body, False)
        self.daylight_score = None
        self.privacy_score = None
        self.dist_to_window = []
        self.dist_to_door = []
        self.anchor = target


# Create furniture instances:
# First, get furniture anchors(source frames) 
bed_anchors = get_anchors(i_bed, True, False)
lounge_anchors = get_anchors(i_lounge, True, False)
desk_anchors = get_anchors(i_desk, True, False)
beds = []
lounges = []
desks = []
furnitures = []

# Second, create furniture instances on each target frame
# once source and target frames are passed to the furniture classes,
# furniture constructors orient furniture curves from a source frame
# to target frames when creating instances.
for target in i_targets: 
    for anchor in bed_anchors:
        bed = Bed(i_bed, anchor, target)
        beds.append(bed)
        furnitures.append(bed)
    for anchor in lounge_anchors:
        lounge = Lounge(i_lounge, anchor, target)
        lounges.append(lounge)
        furnitures.append(lounge)
    for anchor in desk_anchors:
        desk = Desk(i_desk, anchor, target)
        desks.append(desk)
        furnitures.append(desk)

# Set distance between furniture and windows
# max distance to windows/doors is used to calculate daylight/privacy score 
dist_max_wins =  set_dist_to_objects(i_wins, furnitures, True)
dist_max_doors = set_dist_to_objects(i_doors, furnitures, False)

# Compute daylight/privacy scores for furniture instances
set_furniture_score(i_wins, furnitures, dist_max_wins, True, False)
set_furniture_score(i_doors, furnitures, dist_max_doors, False, True)


# Outputs
o_furniture = [beds, lounges, desks]
o_bed_anchors = bed_anchors
o_lounge_anchors = lounge_anchors
o_desk_anchors = desk_anchors
# ---------- end furniture_instances ----------
furnitrue_combinations = GhPythonScript(i_furniture=furniture_instances.o_furniture)  # -> out, o_combinations; inputs i_furniture: list
# ---------- furnitrue_combinations: Python ----------
import Rhino.Geometry as rh

# Functions
def get_combination_counts(lists):
    n = 1
    for list in lists:
        n *= len(list)
    return n

def cross_reference(lists, n):
    divisor = 1
    cross_refs = []
    for list in lists:
        cross_ref = []
        for i in range(n):
            index = (i // divisor) % len(list)
            cross_ref.append(list[index])
        cross_refs.append(cross_ref)
        divisor *= len(list)
    return cross_refs

def generate_combinations(cross_refs, n):
    combinations = []
    for i in range(n):
        combination = []
        for cross_ref in cross_refs:
            combination.append(cross_ref[i])
        combinations.append(combination)
    return combinations


# CrossReference(holistic) every element to generate combinations
combination_counts = get_combination_counts(i_furniture) 
cross_refs = cross_reference(i_furniture, combination_counts)
combinations = generate_combinations(cross_refs, combination_counts)


# Outputs
o_combinations = combinations
# ---------- end furnitrue_combinations ----------

# ----
# Filter Combinations in Collision
collision_detection = GhPythonScript(i_floor=floor, i_door=door_buffer, i_wins=win, i_combinations=furnitrue_combinations.o_combinations)  # -> out, o_combinations, o_count; inputs i_floor: Curve, i_door: Curve, i_wins: list of Curve, i_combinations: list
# ---------- collision_detection: Python ----------
import Rhino.RhinoDoc
import Rhino.Geometry as rh
tol = Rhino.RhinoDoc.ActiveDoc.ModelAbsoluteTolerance

# Functions
def get_vertices(curves):
    vertices = []
    for curve in curves:
        segments = curve.DuplicateSegments()
        for seg in segments:
            vertices.append(seg.PointAtStart)
    return vertices
    
def get_vertices_middle(curves):
    vertices = []
    for curve in curves:
        segments = curve.DuplicateSegments()
        for seg in segments:
            len = seg.GetLength()
            mid = seg.PointAtLength(len / 2)
            vertices.append(seg.PointAtStart)
            vertices.append(mid)
    return vertices

def inside_floor(curve):
    pts = get_vertices([curve])
    for pt in pts:
        # pointContainment(inside = 1, outside = 2, coincident = 3)
        containment = int(i_floor.Contains(pt, rh.Plane.WorldXY, tol))
        if containment == 2:
            return False
    return True

def contain_pts(curve, pts):
    for pt in pts:
        # pointContainment(inside = 1, outside = 2, coincident = 3)
        containment = int(curve.Contains(pt, rh.Plane.WorldXY, tol))
        if containment == 1:
            return True
    return False


# Collision Detection:
# there are two types of collsion(Wall and Furniture mutual collision)
# this component tests those two cases seperately and return combinations with no collision
combinations_filter = []
for combination in i_combinations:
    
    # 1.Wall Collision:
    wall_collision = False
    for furniture in combination:
        # check if Furniture vertices outside floor plan
        if not inside_floor(furniture.body):
            wall_collision = True
            break
        # check if Buffer vertices outside floor plan
        valid_buffer = 0
        for i in reversed(range(len(furniture.buffer))):
            inside = inside_floor(furniture.buffer[i])
            if inside: valid_buffer += 1
            else: furniture.buffer.pop(i)
        if valid_buffer == 0: wall_collision = True
    if wall_collision:
        continue
    
    # 2.Furniture Mutual Collision: 
    furniture_collision = False
    obstacles = [] # obstacles list includes doors to avoid furniture collision with doors
    obstacles_buffers = [] # obstacles_buffers list includes doors
    for furniture in combination:
        obstacles.append(furniture.body)
        obstacles_buffers.append(furniture.buffer)
    obstacles.append(i_door)
    obstacles_buffers.append([i_door])
    # mid points from furniture curves are needed for accurate furniture collision detection
    pts_with_mid = get_vertices_middle(obstacles) 
    
    # check if Furnitures collide each other
    for obstacle in obstacles:
        for pt in pts_with_mid:
            # pointContainment(inside = 1, outside = 2, coincident = 3)
            containment = int(obstacle.Contains(pt, rh.Plane.WorldXY, tol))
            if containment == 1:
                furniture_collision = True
                break        
    
    # check if Buffers collide with Furnitures
    for furniture_buffers in obstacles_buffers:
        for i, buffer in enumerate(furniture_buffers):
            containment = contain_pts(buffer, pts_with_mid)
            if not containment:
                break
            elif i == len(furniture_buffers) - 1:
                furniture_collision = True
    if furniture_collision:
        continue
        
    # check if Lounges collide with Windows
    lounge_window_collision = False
    pts = get_vertices(i_wins)
    for furniture in combination:
        if furniture.name == 'lounge':
            for pt in pts:
                containment = int(furniture.body.Contains(pt, rh.Plane.WorldXY, tol))
                if containment == 1 or containment == 3:
                    lounge_window_collision = True
                    break
    if lounge_window_collision:
        continue

    # Furniture Combinations with no Collisions
    # At this point, combination variable went through all collision detection tests and
    # qualified to be added to combinations_filter list 
    combinations_filter.append(combination)


# Ouputs
o_combinations = combinations_filter
o_count = len(combinations_filter)
# ---------- end collision_detection ----------
visualize = GhPythonScript(i_combinations=collision_detection.o_combinations, index=Slider(0, range=0..33))  # -> out, o_bodies, o_buffers; inputs i_combinations: list, index: Int32
# ---------- visualize: Python ----------
import Rhino.Geometry as rh

# Visualize funiture combinations
combinations_bodies = []
combinations_buffers = []
for combination in i_combinations:
    bodies = []
    buffers = []
    for furniture in combination:
        bodies.append(furniture.body)
        for buffer in furniture.buffer:
            buffers.append(buffer)
    combinations_bodies.append(bodies)
    combinations_buffers.append(buffers)

# Outputs
o_bodies = combinations_bodies[index]
o_buffers = combinations_buffers[index]
# ---------- end visualize ----------
o_count = Panel(collision_detection.o_count)
preview = CustomPreview(Geometry=visualize.o_bodies, Material=ColourSwatch(SwatchColor=RGB(255, 255, 255)))

# ----
# Define Room Instances
# (combination & circulation properties)
panel_3 = Panel("30")
room_instances = GhPythonScript(i_floor=floor, i_door_buffer=door_buffer, i_min_width=panel_3, i_combinations=collision_detection.o_combinations)  # -> out, o_rooms, o_circulation_valid, o_circulation, o_area, o_edges, o_furniture; inputs i_floor: Curve, i_door_buffer: Curve, i_combinations: list
# ---------- room_instances: Python ----------
import Rhino.Geometry as rh
import Rhino.Collections 
import math
tol = Rhino.RhinoDoc.ActiveDoc.ModelAbsoluteTolerance
max_dist = 500 # max searching distance for 'ClosestPoint' function

# Function
def get_vertices(curve):
    vertices = []
    segments = curve.DuplicateSegments()
    for seg in segments:
        vertices.append(seg.PointAtStart)
    return vertices

def project_vec(pt, direction, curve):
    bbox = rh.BoundingBox(get_vertices(curve))
    translate = bbox.Max.DistanceTo(bbox.Min) * direction
    line_crv = rh.LineCurve(pt, pt + translate)
    intersections = rh.Intersect.Intersection.CurveCurve(curve, line_crv, tol, tol)
    shortest = float('inf')
    for inter in intersections:
        dist = inter.PointA.DistanceTo(pt)
        if dist < shortest and dist > tol: shortest = dist
    return direction * shortest

def get_middle(curve):
    half = curve.GetLength() / 2
    pt = curve.PointAtLength(half)
    t = curve.LengthParameter(half)[1]
    return (pt, t)
    
def is_inside(boundary, pt, include_coincident = False): 
    # containment(unset = 0, inside = 1, outside = 2, coincident = 3)
    containment = int(boundary.Contains(pt, rh.Plane.WorldXY, tol))
    if include_coincident:
        if containment == 1 or containment == 3: return True
        else: return False
    else:
        if containment == 1: return True
        else: return False

def is_inside_crv(boundary, crv, include_coincident = False):
    # containment(unset = 0, inside = 1, outside = 2, coincident = 3)
    pts = get_vertices(crv)
    for pt in pts:
        if not is_inside(boundary, pt, include_coincident):
            return False
    return True

def is_coincident(boundary, pt):
    # containment(unset = 0, inside = 1, outside = 2, coincident = 3)
    containment = int(boundary.Contains(pt, rh.Plane.WorldXY, tol))
    if containment == 3: return True
    else: return False

def get_normals_inwards(curve):
    transforms = []
    segments = curve.DuplicateSegments()
    for seg in segments:
        mid = get_middle(seg) # mid(pt, t)
        vec = seg.TangentAt(mid[1])
        vec.Rotate(math.pi / 2, rh.Vector3d(0, 0, 1))
        if is_inside(curve, mid[0] + vec * tol * 10, True): transforms.append(vec)
        else: transforms.append(-vec)
    return transforms

def boolean_diff_crv(curves, source, n = 0): 
    boolean_diff_segs = []
    
    # find pts(curves) conincident on source crv
    conincident_pts = []
    for crv in curves:
        for pt in get_vertices(crv):
            if is_coincident(crv, pt): conincident_pts.append(pt)
    
    # split source crv with conincident pts
    source_parameters = []
    for pt in conincident_pts:
        source_parameters.append(source.ClosestPoint(pt, max_dist)[1])
    source_segs = source.Split(source_parameters)
    
    # save source_segs whose mid is outside of curves to subtract with
    for seg in source_segs:
        outside = True
        for crv in curves:
            mid = get_middle(seg)[0]
            if is_inside(crv, mid, True): 
                outside = False
                break
        if not outside: continue
        boolean_diff_segs.append(seg)
   
    # save curves_segs whose mid is inside source crv
    for crv in curves:
        segments = crv.DuplicateSegments()
        for seg in segments:
            mid = get_middle(seg)[0]
            if is_inside(source, mid, False): boolean_diff_segs.append(seg)
            
    return rh.Curve.JoinCurves(boolean_diff_segs)


# Define Room class:
# furniture combinations(filtered by collision detection) are stored within Room instances as a property
# circulation curve is extracted from each combination and stored within Room instances
# then the circulation curve is tested to see if there are any invalid paths narrower than i_min_width
class Room:
    def __init__(self, floor, door, min_width, combination):
        self.combination = combination
        self.circulation = boolean_diff_crv([furniture.body for furniture in combination], floor)[0]
        self.circulation_valid = self.remove_invalid_paths(self.circulation, min_width)
        self.circulation_valid_area = self.get_area()
        self.circulation_valid_edges = self.get_edges_count(min_width / 2, math.pi / 6)
        self.daylight_score = None
        self.privacy_score = None
        self.circulation_score = None
        self.total_score = None
        
    # area of valid circulation will be used to get circulation score.
    def get_area(self):
        return rh.AreaMassProperties.Compute(self.circulation_valid).Area
    
    # the number of edges of valid circulation curve is used to measure 
    # circulation efficiency and will be used to get circulation score. 
    def get_edges_count(self, tol_segs, tol_angle):
        simplified_crv = self.circulation_valid.DuplicateCurve().ToPolyline()
        simplified_crv.ReduceSegments(tol_segs)
        segments = simplified_crv.ToPolylineCurve().DuplicateSegments()
        edges = 0
        for i in range(len(segments)):
            tan_curr = segments[i].TangentAtStart
            tan_next = segments[(i + 1) % len(segments)].TangentAtStart
            angle = rh.Vector3d.VectorAngle(tan_curr, tan_next)
            if angle > tol_angle: edges += 1
        return edges
        
    def get_invalid_path(self, pt, transform, transforms, seg, segments, circulation):
        vec = project_vec(pt, transform, circulation)
        pt_proj = pt + vec
        invalid_path_pts = [pt, pt_proj]
        for i, seg_pair in enumerate(segments):
            t = seg_pair.ClosestPoint(pt_proj, max_dist)[1]
            pt_pair = seg_pair.PointAt(t)
            if pt_proj.DistanceToSquared(pt_pair) < tol: break
        pt_start_pair = seg_pair.PointAtStart
        pt_end_pair = seg_pair.PointAtEnd
        vec_start_pair = project_vec(pt_start_pair, transforms[i], circulation)
        vec_end_pair = project_vec(pt_end_pair, transforms[i], circulation)
        pt_start_pair_proj = pt_start_pair + vec_start_pair
        pt_end_pair_proj = pt_end_pair + vec_end_pair
        
        t = seg.ClosestPoint(pt_start_pair_proj, max_dist)[1]
        if pt_start_pair_proj.DistanceToSquared(seg.PointAt(t)) < tol:
            invalid_path_pts.append(pt_start_pair)
            invalid_path_pts.append(pt_start_pair_proj)
        t = seg.ClosestPoint(pt_end_pair_proj, max_dist)[1]
        if pt_end_pair_proj.DistanceToSquared(seg.PointAt(t)) < tol:
            invalid_path_pts.append(pt_end_pair)
            invalid_path_pts.append(pt_end_pair_proj)
            
        return (rh.NurbsCurve.Create(True, 1, invalid_path_pts), i)        
        
    # this method detects an removes invalid paths(narrower than i_min_width) from 
    # the circulation curve and return only valid circulation paths. 
    # there are three cases of invalid paths, and this method tests each invalid case separately
    def remove_invalid_paths(self, circulation, min_width):
        door_mid = rh.AreaMassProperties.Compute(i_door_buffer).Centroid
        
        # 1.Remove invalid path segments with both ends narrower than min_width
        iteration = 0
        while iteration < 3:
            both_ends_narrow = 0
            transforms = get_normals_inwards(circulation)
            segments = circulation.DuplicateSegments()
            invalid_paths = []
            for i, seg in enumerate(segments):
                pt_start = seg.PointAtStart
                pt_end = seg.PointAtEnd
                pt_start_xform = pt_start + (transforms[i] * min_width)
                pt_end_xform = pt_end + (transforms[i] * min_width)
                pt_start_outside = not is_inside(circulation, pt_start_xform, True)
                pt_end_outside = not is_inside(circulation, pt_end_xform, True)
                
                if pt_start_outside and pt_end_outside:
                    both_ends_narrow += 1
                    # get project_vec for the point whose translated position is inside circulation curve
                    vec = rh.Vector3d.Unset
                    if is_inside(circulation, pt_start + transforms[i] * tol * 10): 
                        vec = project_vec(pt_start, transforms[i], circulation)
                    if is_inside(circulation, pt_end + transforms[i] * tol * 10):
                        vec = project_vec(pt_end, transforms[i], circulation)
                    invalid_path_pts = [pt_start, pt_start + vec, pt_end + vec, pt_end]
                    
                    # test if invalid path is inside of circulation crv
                    invalid_path = rh.NurbsCurve.Create(True, 1, invalid_path_pts)
                    if is_inside_crv(circulation, invalid_path, True):
                        invalid_paths.append(invalid_path)
                        
            # filter a circulation path adjacent to the door
            if both_ends_narrow > 0:
                circulation_paths = boolean_diff_crv(invalid_paths, circulation)
                for path in circulation_paths:
                    if is_inside(path, door_mid): 
                        circulation = path.Simplify(rh.CurveSimplifyOptions.All, tol, tol)
                    
            # if no more invalid paths with both ends narrower, exit the loop
            elif both_ends_narrow == 0: break
            
            iteration += 1
        
        # 2.Remove invalid path segments with one end narrower than min_width
        invalid_paths = []
        skip = []
        for i, seg in enumerate(segments):
            if i in skip: continue
            pt_start = seg.PointAtStart
            pt_end = seg.PointAtEnd
            pt_start_xform = pt_start + (transforms[i] * min_width)
            pt_end_xform = pt_end + (transforms[i] * min_width)
            pt_start_outside = not is_inside(circulation, pt_start_xform, True)
            pt_end_outside = not is_inside(circulation, pt_end_xform, True)
            
            if pt_start_outside:
                invalid_path = self.get_invalid_path(pt_start, transforms[i], transforms, seg, segments, circulation)
                invalid_paths.append(invalid_path[0])
                skip.append(invalid_path[1])
            if pt_end_outside:
                invalid_path = self.get_invalid_path(pt_end, transforms[i], transforms, seg, segments, circulation)
                invalid_paths.append(invalid_path[0])
                skip.append(invalid_path[1])
    
        # filter a circulation path adjacent to the door
        circulation_paths = boolean_diff_crv(invalid_paths, circulation)
        for path in circulation_paths:
            if is_inside(path, door_mid): 
                circulation = path.Simplify(rh.CurveSimplifyOptions.All, tol, tol)
                
        # 3.Remove invalid corner paths narrower than min_width
        circulation_pts = get_vertices(circulation)
        for i in reversed(range(len(circulation_pts))):
            pt = circulation_pts[i]
            del circulation_pts[i]
            cp = Rhino.Collections.Point3dList.ClosestPointInList(circulation_pts, pt)
            dist = pt.DistanceTo(cp)
            is_corner = is_inside(circulation, (pt + cp) / 2)
            if dist < min_width and is_corner:
                t1 = circulation.ClosestPoint(pt, max_dist)[1]
                t2 = circulation.ClosestPoint(cp, max_dist)[1]
                circulation_segs =  circulation.Split([t1, t2])
                for seg in circulation_segs:
                    line_crv = rh.LineCurve(seg.PointAtStart, seg.PointAtEnd)
                    path = rh.Curve.JoinCurves([seg, line_crv])[0]
                    if is_inside(path, door_mid):
                        circulation = path
            circulation_pts.append(pt)
            
        return circulation

# Create Room instances from filtered combinations
rooms = []
for combination in i_combinations:
    room = Room(i_floor, i_door_buffer, i_min_width, combination)
    rooms.append(room)
    
    
# Outputs
o_rooms = rooms
o_circulation_valid = [room.circulation_valid for room in rooms]
o_circulation = [room.circulation for room in rooms]
o_area = [room.circulation_valid_area for room in rooms]
o_edges = [room.circulation_valid_edges for room in rooms]
# ---------- end room_instances ----------
number_slider = Slider(7, range=0..33)
item = ListItem(List=room_instances.o_circulation_valid, Index=number_slider, Wrap=True)
item_2 = ListItem(List=room_instances.o_circulation, Index=number_slider, Wrap=True)
item_3 = ListItem(List=room_instances.o_area, Index=number_slider, Wrap=True)
item_4 = ListItem(List=room_instances.o_edges, Index=number_slider, Wrap=True)
area_edges = Panel([item_3, item_4])

# ----
# User
# Inputs
panel_4 = Panel("10")

# ----
# Recommend Combinations
# with High Scores
recommend_combinations = GhPythonScript(
    i_rooms=room_instances.o_rooms,
    i_counts=panel_4,
    i_daylight_weight="1.0",
    i_privacy_weight="1.0",
    i_circulation_weight="2.0")  # -> out, o_combinations, o_circulations_valid, o_anchors; inputs i_rooms: list, i_counts: Int32
# ---------- recommend_combinations: Python ----------
import Rhino.Geometry as rh

# Functions
def remap(value, source, target):
    normal_value = (value - source.T0) / source.Length
    new_value = (target.T0 + normal_value) * target.Length
    return new_value

def get_circulation_score(edges_interval, area_interval, area, edges):
    area_weight = 0.8
    edges_weight = 0.2
    score_interval = rh.Interval(0, 100)
    area_score = remap(area, area_interval, score_interval) * area_weight
    edges_score = remap(edges, edges_interval, score_interval) * edges_weight
    return area_score + edges_score

def print_scores(rooms):
    for room in rooms:
        total_string = 'total:{:.0f}'.format(room.total_score)
        daylight_string = 'daylight:{:.0f}'.format(room.daylight_score)
        privacy_string = 'privacy:{:.0f}'.format(room.privacy_score)
        circulation_string = 'circulation:{:.0f}'.format(room.circulation_score)
        area_string = 'area:{:.0f}ft2'.format(room.circulation_valid_area / 144)
        print(total_string, daylight_string, privacy_string, circulation_string, area_string)

# Recommend combinations:
# get edge and area intervals to compute circulation score
edge_max = 0
area_max = 0
area_min = float('inf')
for room in i_rooms:
    edges = room.circulation_valid_edges
    area = room.circulation_valid_area
    if edges > edge_max: edge_max = edges
    if area > area_max: area_max = area
    if area < area_min: area_min = area
edges_interval = rh.Interval(edge_max, 4) # edge interval is reversed --> less edges higher score
area_interval = rh.Interval(area_min, area_max)

# Compute daylight/privacy/circulation total scores
for room in i_rooms:
    daylight_score = 0
    privacy_score = 0
    for furniture in room.combination:
        daylight_score += furniture.daylight_score
        privacy_score += furniture.privacy_score
    room.daylight_score = daylight_score / len(room.combination) * i_daylight_weight
    room.privacy_score = privacy_score / len(room.combination) * i_privacy_weight
    room.circulation_score = get_circulation_score(edges_interval, area_interval, room.circulation_valid_area, room.circulation_valid_edges) * i_circulation_weight
    room.total_score = room.daylight_score + room.privacy_score + room.circulation_score

# Sort rooms with total scores to filter high performing options
rooms_sorted = sorted(i_rooms, key = lambda x : x.total_score, reverse=True)
rooms_selected = rooms_sorted[:i_counts]

# Outputs
print_scores(rooms_selected)
o_combinations = [room.combination for room in rooms_selected]
o_circulations_valid = [room.circulation_valid for room in rooms_selected]
# ---------- end recommend_combinations ----------
panel_5 = Panel(recommend_combinations.out)

# ----
# Render Furniture 3D
# (recommended combinations)
number_slider_2 = Slider(4, range=0..14)
item_5 = ListItem(List=recommend_combinations.out, Index=number_slider_2, Wrap=True)
circulation = ListItem(List=recommend_combinations.o_circulations_valid, Index=number_slider_2, Wrap=True)
visualize_2 = GhPythonScript(i_combinations=recommend_combinations.o_combinations, index=number_slider_2)  # -> out, o_bodies, o_anchor_bed, o_anchor_lounge, o_anchor_desk; inputs i_combinations: list, index: Int32
# ---------- visualize_2: Python ----------
import Rhino.Geometry as rh

# Visualize funiture combinations
combinations_bodies = []
combinations_anchors = []
for combination in i_combinations:
    bodies = []
    anchors = []
    for furniture in combination:
        bodies.append(furniture.body)
        anchors.append(furniture.anchor)
    combinations_bodies.append(bodies)
    combinations_anchors.append(anchors)

# Outputs
o_bodies = combinations_bodies[index]
o_anchor_bed = combinations_anchors[index][0]
o_anchor_lounge = combinations_anchors[index][1]
o_anchor_desk = combinations_anchors[index][2]
# ---------- end visualize_2 ----------
score = Panel(item_5)
move = Move(Geometry=circulation, Motion="{0, 0, 0.1}")  # -> Geometry, Transform
_3d_lounge_color = Geometry(<mesh referenced from the Rhino model>)
_3d_desk_color = Geometry(<mesh referenced from the Rhino model>)
_3d_bed_color = Geometry([<mesh referenced from the Rhino model> x3])
_3d_lounge = Geometry([<mesh referenced from the Rhino model> x2])
_3d_desk = Geometry(<mesh referenced from the Rhino model>)
_3d_bed = Geometry([<mesh referenced from the Rhino model> x4])
bed_2 = Entwine(Branch00=_3d_bed, Branch01=_3d_bed_color, FlattenInputs=True)
lounge_2 = Entwine(Branch00=_3d_lounge, Branch01=_3d_lounge_color, FlattenInputs=True)
desk_2 = Entwine(Branch00=_3d_desk, Branch01=_3d_desk_color, FlattenInputs=True)
orient = Orient(Geometry=bed_2, Source=furniture_instances.o_bed_anchors, Target=visualize_2.o_anchor_bed)  # -> simplify(Geometry), Transform
orient_2 = Orient(Geometry=lounge_2, Source=furniture_instances.o_lounge_anchors, Target=visualize_2.o_anchor_lounge)  # -> simplify(Geometry), Transform
orient_3 = Orient(Geometry=desk_2, Source=furniture_instances.o_desk_anchors, Target=visualize_2.o_anchor_desk)  # -> simplify(Geometry), Transform
bang = ExplodeTree(Data=orient.Geometry)  # -> Branch0, Branch1
bang_2 = ExplodeTree(Data=orient_2.Geometry)  # -> Branch0, Branch1
bang_3 = ExplodeTree(Data=orient_3.Geometry)  # -> Branch0, Branch1
preview_2 = CustomPreview(Geometry=bang.Branch1, Material=ColourSwatch(SwatchColor=RGB(224, 150, 150)))
preview_3 = CustomPreview(Geometry=bang_2.Branch0, Material=ColourSwatch(SwatchColor=RGB(255, 255, 255)))
preview_4 = CustomPreview(Geometry=bang_2.Branch1, Material=ColourSwatch(SwatchColor=RGB(222, 201, 82)))
preview_5 = CustomPreview(Geometry=bang_3.Branch0, Material=ColourSwatch(SwatchColor=RGB(255, 255, 255)))
preview_6 = CustomPreview(Geometry=bang_3.Branch1, Material=ColourSwatch(SwatchColor=RGB(181, 139, 72)))
preview_7 = CustomPreview(Geometry=bang.Branch0, Material=ColourSwatch(SwatchColor=RGB(255, 255, 255)))

# ----
# Visualizaion: Daylight
door_curve = Curve(<curve referenced from the Rhino model>)
furniture = Geometry(visualize_2.o_bodies)
area = Area(Geometry=door_curve)  # -> Area, Centroid
area_2 = Area(Geometry=furniture)  # -> Area, Centroid
Z = UnitZ(Factor="30")
move_2 = Move(Geometry=area_2.Centroid, Motion=Z)  # -> Geometry, Transform
ln = Line(StartPoint=area.Centroid, EndPoint=move_2.Geometry)
merge = Merge(
    Data1=simplify(flatten(door_curve)),
    Data2=simplify(flatten(furniture)),
    Data3=simplify(flatten(ln)),
    Data4=simplify(flatten(area.Centroid)))
sph = Sphere(Base=move_2.Geometry, Radius=1)
preview_8 = CustomPreview(Geometry=[ln, merge, sph], Material=ColourSwatch(SwatchColor=RGB(255, 82, 82)))

# ----
# Visualizaion: Privacy
win_curve = Curve(<curve referenced from the Rhino model>)
furniture_2 = Geometry(visualize_2.o_bodies)
area_3 = Area(Geometry=win_curve)  # -> Area, Centroid
area_4 = Area(Geometry=furniture_2)  # -> Area, Centroid
Z_2 = UnitZ(Factor="30")
move_3 = Move(Geometry=area_4.Centroid, Motion=Z_2)  # -> Geometry, Transform
ln_2 = Line(StartPoint=area_3.Centroid, EndPoint=move_3.Geometry)
merge_2 = Merge(
    Data1=simplify(flatten(win_curve)),
    Data2=simplify(flatten(furniture_2)),
    Data3=simplify(flatten(ln_2)),
    Data4=simplify(flatten(area_3.Centroid)))
sph_2 = Sphere(Base=move_3.Geometry, Radius=1)
preview_9 = CustomPreview(Geometry=[ln_2, sph_2, merge_2], Material=ColourSwatch(SwatchColor=RGB(255, 82, 82)))

# ----
# Visualizaion: Circulation
panel_6 = Panel("1")
boundary = BoundarySurfaces(Edges=move.Geometry)
Z_3 = UnitZ(Factor=panel_6)
area_5 = Area(Geometry=boundary)  # -> Area, Centroid
move_4 = Move(Geometry=boundary, Motion=Z_3)  # -> Geometry, Transform
division = Division(A=area_5.Area, B="144")
round = Round(Number=division)  # -> Nearest, Floor, Ceiling
concat = Concatenate(FragmentA=round.Nearest, FragmentB="ft2")
preview_10 = CustomPreview(Geometry=move.Geometry, Material=ColourSwatch(SwatchColor=RGB(62, 176, 0)))
preview_11 = CustomPreview(Geometry=move_4.Geometry, Material=ColourSwatch(SwatchColor=RGB(155, 209, 125)))
tag = TextTag(Location=area_5.Centroid, Text=concat)
