# Grasshopper definition daylight_guided_furniture_layout.gh (Grasshopper 1.0.7)

# ----
# Room
# Input
win = Curve([<curve referenced from the Rhino model> x2])
floor = Curve(<curve referenced from the Rhino model>)
door_buffer = Curve(<curve referenced from the Rhino model>)

# ----
# Furniture
# Input
lounge = Curve(<curve referenced from the Rhino model>)
desk = Curve(<curve referenced from the Rhino model>)
bed = Curve(<curve referenced from the Rhino model>)

# ----
# Floor plan subdivision &
# Set horizontal frames
panel = Panel("60")
divlength_hframes = GhPythonScript(i_curve=floor, i_length=panel)  # -> out, o_frames; inputs i_curve: Curve
# ---------- divlength_hframes: Python ----------
import Rhino.Geometry as rh
import math


# Functions
def explode(curve):
    segments = curve.DuplicateSegments()
    return segments

def div_equi_length(segments, length):
    segments_parameters = []
    divisors = []
    for seg in segments:
         divisors.append(round(seg.GetLength() / length))
    for i, seg in enumerate(segments):
        parameters = seg.DivideByCount(divisors[i], True)
        segments_parameters.append(parameters)
    return segments_parameters

def get_horizontal_frame(segments, parameters):
    horizontal_frames = []
    for i, seg in enumerate(segments):
        for t in parameters[i]:
            plane_x = rh.Vector3d(seg.TangentAt(t).X, seg.TangentAt(t).Y, 0)
            plane_x.Unitize()
            plane_y = rh.Vector3d(seg.TangentAt(t).X, seg.TangentAt(t).Y, 0)
            plane_y.Rotate(math.pi * 0.5, rh.Vector3d.ZAxis)
            plane_y.Unitize()
            h_frame = rh.Plane(seg.PointAt(t), plane_x, plane_y)
            horizontal_frames.append(h_frame)
    return horizontal_frames


# Subdivide floor plan and set horizontal frames
segments = explode(i_curve)
segments_parameters = div_equi_length(segments, i_length)
horizontal_frames = get_horizontal_frame(segments, segments_parameters)


# Outputs
o_frames = horizontal_frames
# ---------- end divlength_hframes ----------

# ----
# Define Furnitrue Instances &
# Iterate Furniture Combinations
panel_2 = Panel("30")
furniture_instances = GhPythonScript(
    i_bed=bed,
    i_bed_buffer="30",
    i_lounge=lounge,
    i_lounge_buffer=panel_2,
    i_desk=desk,
    i_desk_buffer="35",
    i_targets=divlength_hframes.o_frames)  # -> out, o_furniture, o_bed_anchors, o_lounge_anchors, o_desk_anchors; inputs i_bed: Curve, i_lounge: Curve, i_desk: Curve, i_targets: list of Plane
# ---------- furniture_instances: Python ----------
import Rhino.RhinoDoc
import Rhino.Geometry as rh
import math
tol = Rhino.RhinoDoc.ActiveDoc.ModelAbsoluteTolerance

# functions
def get_vertices(curve):
    vertices = []
    segments = curve.DuplicateSegments()
    for seg in segments:
        vertices.append(seg.PointAtStart)
    return vertices

def shortest_length(curve):
    segments = curve.DuplicateSegments()
    shortest = segments[0].GetLength()
    for i in range(1, len(segments)):
        length = segments[i].GetLength()
        if  shortest > length:
            shortest = length
    return shortest
    
def get_middle(curve):
    return curve.PointAtLength(curve.GetLength() / 2)
    
def get_horizontal_frame(curve, t):
    plane_x = rh.Vector3d(curve.TangentAt(t).X, curve.TangentAt(t).Y, 0)
    plane_x.Unitize()
    plane_y = rh.Vector3d(curve.TangentAt(t).X, curve.TangentAt(t).Y, 0)
    plane_y.Rotate(math.pi * 0.5, rh.Vector3d.ZAxis)
    plane_y.Unitize()
    horizontal_frame = rh.Plane(curve.PointAt(t), plane_x, plane_y)
    return horizontal_frame
    
def get_anchors(curve, left, top):
    segments = curve.DuplicateSegments()
    anchors = []
    
    if left:
        seg_left = segments[0]
        for seg in segments:
            if get_middle(seg_left).X > get_middle(seg).X:
                seg_left = seg
        anchors.append(get_horizontal_frame(seg_left, seg_left.Domain.Mid))
        
    if top:
        seg_top = segments[0]
        for seg in segments:
            if get_middle(seg_top).Y < get_middle(seg).Y:
                seg_top = seg
        anchors.append(get_horizontal_frame(seg_top, seg_top.Domain.Mid))
        
    return anchors
    
def orient(geometry, source, target):
    xform = rh.Transform.PlaneToPlane(source, target)
    geometry.Transform(xform)


# define furniture classes
class Bed:
    def __init__(self, body, source, target):
        self.body = body.Duplicate()
        orient(self.body, source, target)
        self.buffer = self.get_buffer()
    
    def get_buffer(self):
        buffer = []
        shortest = shortest_length(self.body)
        pts = get_vertices(self.body)
        n = len(pts)
        
        for i in range(n):
            dist = pts[i].DistanceTo(pts[(i+1) % n])
            if abs(dist - shortest) > tol: # for long sides of rectangles
                vec = pts[(i+1) % n] - pts[(i+2) % n]
                vec.Unitize()
                translate = vec * i_bed_buffer
                buffer_pts = [pts[i], pts[(i+1) % n], pts[(i+1) % n] + translate, pts[i] + translate]
                curve = rh.NurbsCurve.Create(True, 1, buffer_pts)
                buffer.append(curve)
        return buffer

class Lounge:
    def __init__(self, body, source, target):
        self.body = body.Duplicate()
        orient(self.body, source, target)
        self.buffer = self.get_buffer()
        
    def get_buffer(self):
        buffer = []
        shortest = shortest_length(self.body)
        pts = get_vertices(self.body)
        n = len(pts)
        
        for i in range(n):
            dist = pts[i].DistanceTo(pts[(i+1) % n])
            if abs(dist - shortest) > tol: # for long sides of rectangles
                vec = pts[(i+1) % n] - pts[(i+2) % n]
                vec.Unitize()
                translate = vec * i_bed_buffer
                buffer_pts = [pts[i], pts[(i+1) % n], pts[(i+1) % n] + translate, pts[i] + translate]
                curve = rh.NurbsCurve.Create(True, 1, buffer_pts)
                buffer.append(curve)
        return buffer
     
class Desk:
    def __init__(self, body, source, target):
        self.body = body.Duplicate()
        orient(self.body, source, target)
        self.buffer = self.get_buffer()
        
    def get_buffer(self):
        buffer = []
        shortest = shortest_length(self.body)
        pts = get_vertices(self.body)
        n = len(pts)
        
        for i in range(n):
            dist = pts[i].DistanceTo(pts[(i+1) % n])
            if abs(dist - shortest) > tol: # for long sides of rectangles
                vec = pts[(i+1) % n] - pts[(i+2) % n]
                vec.Unitize()
                translate = vec * i_bed_buffer
                buffer_pts = [pts[i], pts[(i+1) % n], pts[(i+1) % n] + translate, pts[i] + translate]
                curve = rh.NurbsCurve.Create(True, 1, buffer_pts)
                buffer.append(curve)
                break
        return buffer
      
      
# create furniture instances
bed_anchors = get_anchors(i_bed, True, True)
lounge_anchors = get_anchors(i_lounge, True, False)
desk_anchors = get_anchors(i_desk, True, False)
beds = []
lounges = []
desks = []

for target in i_targets:
    for anchor in bed_anchors:
        beds.append(Bed(i_bed, anchor, target))
    for anchor in lounge_anchors:
        lounges.append(Lounge(i_lounge, anchor, target))
    for anchor in desk_anchors:
        desks.append(Desk(i_desk, anchor, target))

      
# outputs
o_furniture = [beds, lounges, desks]
o_bed_anchors = bed_anchors
o_lounge_anchors = lounge_anchors
o_desk_anchors = desk_anchors
# ---------- end furniture_instances ----------
furnitrue_combinations = GhPythonScript(i_furniture=furniture_instances.o_furniture)  # -> out, o_combinations; inputs i_furniture: list
# ---------- furnitrue_combinations: Python ----------
import Rhino.Geometry as rh

# Functions
def get_combination_counts(lists):
    n = 1
    for list in lists:
        n *= len(list)
    return n

def cross_reference(lists, n):
    divisor = 1
    cross_refs = []
    for list in lists:
        cross_ref = []
        for i in range(n):
            index = (i // divisor) % len(list)
            cross_ref.append(list[index])
        cross_refs.append(cross_ref)
        divisor *= len(list)
    return cross_refs

def generate_combinations(cross_refs, n):
    combinations = []
    for i in range(n):
        combination = []
        for cross_ref in cross_refs:
            combination.append(cross_ref[i])
        combinations.append(combination)
    return combinations


# CrossReference(holistic) every element
combination_counts = get_combination_counts(i_furniture) 
cross_refs = cross_reference(i_furniture, combination_counts)
combinations = generate_combinations(cross_refs, combination_counts)


# Outputs
o_combinations = combinations
# ---------- end furnitrue_combinations ----------

# ----
# Filter Combinations in Collision
collision_detection = GhPythonScript(i_floor=floor, i_door=door_buffer, i_win=win, i_combinations=furnitrue_combinations.o_combinations)  # -> out, o_combinations, o_count; inputs i_floor: Curve, i_door: Curve, i_win: list of Curve, i_combinations: list
# ---------- collision_detection: Python ----------
import Rhino.RhinoDoc
import Rhino.Geometry as rh
tol = Rhino.RhinoDoc.ActiveDoc.ModelAbsoluteTolerance

# Functions
def get_vertices(curves):
    vertices = []
    for curve in curves:
        segments = curve.DuplicateSegments()
        for seg in segments:
            vertices.append(seg.PointAtStart)
    return vertices
    
def get_vertices_middle(curves):
    vertices = []
    for curve in curves:
        segments = curve.DuplicateSegments()
        for seg in segments:
            len = seg.GetLength()
            mid = seg.PointAtLength(len / 2)
            vertices.append(seg.PointAtStart)
            vertices.append(mid)
    return vertices

def inside_floor(curve):
    pts = get_vertices([curve])
    for pt in pts:
        containment = int(i_floor.Contains(pt, rh.Plane.WorldXY, tol))
        if containment == 2:
            return False
    return True

def contain_pts(curve, pts):
    for pt in pts:
        containment = int(curve.Contains(pt, rh.Plane.WorldXY, tol))
        if containment == 1:
            return True
    return False


# Collision Detection:
# pointContainment(unset = 0, inside = 1, outside = 2, coincident = 3)
combinations_filter = []
for combination in i_combinations:
    
    # Wall Collision:
    wall_collision = False
    for furniture in combination:
        # check if Furniture vertices outside floor plan
        if not inside_floor(furniture.body):
            wall_collision = True
            break
        # check if Buffer vertices outside floor plan
        valid_buffer = 0
        for i in reversed(range(len(furniture.buffer))):
            inside = inside_floor(furniture.buffer[i])
            if inside: valid_buffer += 1
            else: furniture.buffer.pop(i)
        if valid_buffer == 0: wall_collision = True
    if wall_collision:
        continue
    
    # Furniture Collision: 
    furniture_collision = False
    obstacles = [] # add i_door to obstacles list
    obstacles_buffers = [] # add i_door to obstacles_buffers list
    for furniture in combination:
        obstacles.append(furniture.body)
        obstacles_buffers.append(furniture.buffer)
    obstacles.append(i_door)
    obstacles_buffers.append([i_door])
    pts_with_mid = get_vertices_middle(obstacles) 
    
    # check if Furnitures collide each other
    for obstacle in obstacles:
        for pt in pts_with_mid:
            containment = int(obstacle.Contains(pt, rh.Plane.WorldXY, tol))
            if containment == 1:
                furniture_collision = True
                break        
    
    # check if Buffers collide with Furnitures
    for furniture_buffers in obstacles_buffers:
        for i, buffer in enumerate(furniture_buffers):
            containment = contain_pts(buffer, pts_with_mid)
            if not containment:
                break
            elif i == len(furniture_buffers) - 1:
                furniture_collision = True
    if furniture_collision:
        continue

    # Furniture Combinations with no Collisions
    combinations_filter.append(combination)


# Ouputs
o_combinations = combinations_filter
o_count = len(combinations_filter)
# ---------- end collision_detection ----------
o_count = Panel(collision_detection.o_count)
visualize = GhPythonScript(i_combinations=collision_detection.o_combinations, index=Slider(89, range=0..165))  # -> out, o_bodies, o_buffers; inputs i_combinations: list, index: Int32
# ---------- visualize: Python ----------
import Rhino.Geometry as rh

# Visualize funiture combinations
combinations_bodies = []
combinations_buffers = []
for combination in i_combinations:
    bodies = []
    buffers = []
    for furniture in combination:
        bodies.append(furniture.body)
        for buffer in furniture.buffer:
            buffers.append(buffer)
    combinations_bodies.append(bodies)
    combinations_buffers.append(buffers)

# Outputs
o_bodies = combinations_bodies[index]
o_buffers = combinations_buffers[index]
# ---------- end visualize ----------
preview = CustomPreview(Geometry=visualize.o_bodies, Material=ColourSwatch(SwatchColor=RGB(255, 255, 255)))

# ----
# (Need to Define Evaluation logic)
area = Area(Geometry=visualize.o_bodies)  # -> Area, Centroid
# Bed: Longer distance from window -> Higher score
# Lounge: Shorter distance from the window -> Higher score
# Desk: Shorter distance from the window -> Higher score
area_2 = Area(Geometry=win)  # -> Area, Centroid
dist = Distance(PointA=area.Centroid, PointB=area_2.Centroid)
bang = ExplodeTree(Data=dist)  # -> _00000, Branch1, Branch2
ln = Line()
num_bed = Number(bang._00000)
num_lounge = Number(bang.Branch1)
num_desk = Number(bang.Branch2)
panel_3 = Panel([num_bed, num_lounge, num_desk])
num_illuminance_proxy = Number(dist)
