# Grasshopper definition dividing_spaces_exercise.gh (Grasshopper 1.0.7)

pipeline = GeometryPipeline(
    GroupByLayer=False,
    GroupByType=False,
    IncludeHidden=True,
    IncludeLocked=True,
    LayerFilter="boundary",
    NameFilter="*",
    SublayerFiltering=True,
    TypeFilter=4)
project = Project(Geometry=pipeline, Plane=PlaneXY(0, 0, 0))  # -> Geometry, Transform
bbox = BoundingBox(Content=project.Geometry, Plane=PlaneXY(0, 0, 0))  # -> Box, Box_2
debox = DeconstructBox(Box=bbox.Box)  # -> Plane, X, Y, Z
dedomain = DeconstructDomain(Domain=debox.X)  # -> Start, End
dedomain_2 = DeconstructDomain(Domain=debox.Y)  # -> Start, End

# ---- group: Direction Parameter
number_slider = Slider(0, range=0..1)

# ----
subtraction = Subtraction(A=dedomain.End, B=dedomain.Start)
subtraction_2 = Subtraction(A=dedomain_2.End, B=dedomain_2.Start)
X = UnitX(Factor=1)
Y = UnitY(Factor=1)
merge = Merge(Data1=X, Data2=Y)
merge_2 = Merge(Data1=subtraction, Data2=subtraction_2)
pt = ConstructPoint(XCoordinate=dedomain.Start, YCoordinate=dedomain_2.Start, ZCoordinate=0)
subtraction_3 = Subtraction(A=number_slider, B="1")
abs = Absolute(Value=subtraction_3)

# ---- group: Split Parameter
number_slider_2 = Slider(0.33, range=0..1)

# ----
item = ListItem(List=merge_2, Index=number_slider, Wrap=True)
item_2 = ListItem(List=merge, Index=number_slider, Wrap=True)
item_3 = ListItem(List=merge_2, Index=abs, Wrap=True)
item_4 = ListItem(List=merge, Index=abs, Wrap=True)
multiplication = Multiplication(A=item, B=number_slider_2)
amp = Amplitude(Vector=item_2, Amplitude=multiplication)
amp_2 = Amplitude(Vector=item_4, Amplitude=item_3)
move = Move(Geometry=pt, Motion=amp)  # -> Geometry, Transform
# Python: Subdivision
python = GhPythonScript(boundary=pipeline, direction=number_slider, split=number_slider_2)  # -> out, curves; inputs boundary: Curve, direction: Int32
# ---------- python: Python ----------
import Rhino.Geometry as rh
from scriptcontext import doc

tol = doc.ModelAbsoluteTolerance

bounding_box = boundary.GetBoundingBox(True)
base_pt = rh.Point3d(bounding_box.Min.X, bounding_box.Min.Y, 0)
x = bounding_box.Max.X - bounding_box.Min.X
y = bounding_box.Max.Y - bounding_box.Min.Y

dims = [x, y]
vecs = [rh.Vector3d(1, 0, 0), rh.Vector3d(0, 1, 0)]

vec_1 = vecs[direction] * dims[direction] * split
new_pt_1 = rh.Point3d(base_pt)
new_pt_1.Transform(rh.Transform.Translation(vec_1))

other_dir = abs(direction - 1)
vec_2 = vecs[other_dir] * dims[other_dir]
new_pt_2 = rh.Point3d(new_pt_1)
new_pt_2.Transform(rh.Transform.Translation(vec_2))

split_line = rh.Line(new_pt_1, new_pt_2)
inter = rh.Intersect.Intersection.CurveLine(boundary, split_line, tol, tol)
params = [i.ParameterA for i in inter]
pieces = boundary.Split(params)

curves = []

for piece in pieces:
    line = rh.Line(piece.PointAtStart, piece.PointAtEnd)
    curve = rh.NurbsCurve.JoinCurves([piece, line.ToNurbsCurve()])[0]
    curves.append(curve)
# ---------- end python ----------
move_2 = Move(Geometry=move.Geometry, Motion=amp_2)  # -> Geometry, Transform
panel = Panel(python.curves)
ln = Line(StartPoint=move.Geometry, EndPoint=move_2.Geometry)
clx = CurveLine(Curve=pipeline, Line=ln)  # -> Points, Params, Count
shatter = Shatter(Curve=pipeline, Parameters=clx.Params)
end = EndPoints(Curve=shatter)  # -> Start, End
ln_2 = Line(StartPoint=end.Start, EndPoint=end.End)
merge_3 = Merge(Data1=simplify(graft(shatter)), Data2=simplify(graft(ln_2)))
join = JoinCurves(Curves=merge_3, Preserve=False)
area = Area(Geometry=join)  # -> Area, Centroid
tag = TextTag(Location=area.Centroid, Text=area.Area)
