# Grasshopper definition daylight_guided_furniture_layout.gh (Grasshopper 1.0.7)

# ----
# Furniture
# Input
bed = Curve(<curve referenced from the Rhino model>)
lounge = Curve(<curve referenced from the Rhino model>)
desk = Curve(<curve referenced from the Rhino model>)

# ----
# Room
# Input
floor = Curve(<curve referenced from the Rhino model>)
door_buffer = Curve(<curve referenced from the Rhino model>)
win = Curve([<curve referenced from the Rhino model> x2])
door = Curve(<curve referenced from the Rhino model>)

# ----
# Floor plan subdivision &
# Set horizontal frames
panel = Panel("60")
divlength_hframes = GhPythonScript(i_curve=floor, i_length=panel)  # -> out, o_frames; inputs i_curve: Curve
# ---------- divlength_hframes: Python ----------
import Rhino.Geometry as rh
import math


# Functions
def explode(curve):
    segments = curve.DuplicateSegments()
    return segments

def div_equi_length(segments, length):
    segments_parameters = []
    divisors = []
    for seg in segments:
         divisors.append(round(seg.GetLength() / length))
    for i, seg in enumerate(segments):
        parameters = seg.DivideByCount(divisors[i], True)
        segments_parameters.append(parameters)
    return segments_parameters

def get_horizontal_frame(segments, parameters):
    horizontal_frames = []
    for i, seg in enumerate(segments):
        for t in parameters[i]:
            plane_x = rh.Vector3d(seg.TangentAt(t).X, seg.TangentAt(t).Y, 0)
            plane_x.Unitize()
            plane_y = rh.Vector3d(seg.TangentAt(t).X, seg.TangentAt(t).Y, 0)
            plane_y.Rotate(math.pi * 0.5, rh.Vector3d.ZAxis)
            plane_y.Unitize()
            h_frame = rh.Plane(seg.PointAt(t), plane_x, plane_y)
            horizontal_frames.append(h_frame)
    return horizontal_frames


# Subdivide floor plan and set horizontal frames
segments = explode(i_curve)
segments_parameters = div_equi_length(segments, i_length)
horizontal_frames = get_horizontal_frame(segments, segments_parameters)


# Outputs
o_frames = horizontal_frames
# ---------- end divlength_hframes ----------

# ----
# Define Furnitrue Instances &
# Iterate Furniture Combinations
panel_2 = Panel("30")
furniture_instances = GhPythonScript(
    i_targets=divlength_hframes.o_frames,
    i_wins=win,
    i_doors=door,
    i_bed=bed,
    i_bed_buffer="30",
    i_lounge=lounge,
    i_lounge_buffer=panel_2,
    i_desk=desk,
    i_desk_buffer="35")  # -> out, o_furniture, o_bed_anchors, o_lounge_anchors, o_desk_anchors; inputs i_targets: list of Plane, i_wins: list of Curve, i_doors: list of Curve, i_bed: Curve, i_lounge: Curve, i_desk: Curve
# ---------- furniture_instances: Python ----------
import Rhino.RhinoDoc
import Rhino.Geometry as rh
import math
tol = Rhino.RhinoDoc.ActiveDoc.ModelAbsoluteTolerance

# Functions
def get_vertices(curve):
    vertices = []
    segments = curve.DuplicateSegments()
    for seg in segments:
        vertices.append(seg.PointAtStart)
    return vertices

def shortest_length(curve):
    segments = curve.DuplicateSegments()
    shortest = segments[0].GetLength()
    for i in range(1, len(segments)):
        length = segments[i].GetLength()
        if  shortest > length:
            shortest = length
    return shortest
    
def get_middle(curve):
    return curve.PointAtLength(curve.GetLength() / 2)
    
def get_horizontal_frame(curve, t):
    plane_x = rh.Vector3d(curve.TangentAt(t).X, curve.TangentAt(t).Y, 0)
    plane_x.Unitize()
    plane_y = rh.Vector3d(curve.TangentAt(t).X, curve.TangentAt(t).Y, 0)
    plane_y.Rotate(math.pi * 0.5, rh.Vector3d.ZAxis)
    plane_y.Unitize()
    horizontal_frame = rh.Plane(curve.PointAt(t), plane_x, plane_y)
    return horizontal_frame
    
def get_anchors(curve, left, top):
    segments = curve.DuplicateSegments()
    anchors = []
    if left:
        seg_left = segments[0]
        for seg in segments:
            if get_middle(seg_left).X > get_middle(seg).X:
                seg_left = seg
        anchors.append(get_horizontal_frame(seg_left, seg_left.Domain.Mid))
        
    if top:
        seg_top = segments[0]
        for seg in segments:
            if get_middle(seg_top).Y < get_middle(seg).Y:
                seg_top = seg
        anchors.append(get_horizontal_frame(seg_top, seg_top.Domain.Mid))
        
    return anchors
    
def get_buffer(curve, both_sides):
    buffer = []
    shortest = shortest_length(curve)
    pts = get_vertices(curve)
    n = len(pts)
    for i in range(n):
        dist = pts[i].DistanceTo(pts[(i+1) % n])
        if abs(dist - shortest) > tol: # for long sides of rectangles
            vec = pts[(i+1) % n] - pts[(i+2) % n]
            vec.Unitize()
            translate = vec * i_bed_buffer
            buffer_pts = [pts[i], pts[(i+1) % n], pts[(i+1) % n] + translate, pts[i] + translate]
            curve = rh.NurbsCurve.Create(True, 1, buffer_pts)
            buffer.append(curve)
            if not both_sides: break
    return buffer    
    
def orient(geometry, source, target):
    xform = rh.Transform.PlaneToPlane(source, target)
    geometry.Transform(xform)
    
def remap(value, source, target):
    normal_value = (value - source.T0) / source.Length
    new_value = (target.T0 + normal_value) * target.Length
    return new_value

 # get maximum distance between furniture and objs, and store the dist to furniture instances 
def set_dist_to_objects(objects, furnitures, is_window):
    centroid_objects = []
    for obj in objects:
        amp = rh.AreaMassProperties.Compute(obj)
        centroid_objects.append(amp.Centroid)
    dist_max = []
    for _ in range(len(objects)):
        dist_max.append(0)
    for furniture in furnitures:
        amp = rh.AreaMassProperties.Compute(furniture.body)
        centroid_fur = amp.Centroid
        for i, centroid_obj in enumerate(centroid_objects):
            dist = centroid_fur.DistanceTo(centroid_obj)
            if is_window: furniture.dist_to_window.append(dist)
            else: furniture.dist_to_door.append(dist)
            if dist_max[i] < dist: dist_max[i] = dist
    return dist_max
    
def set_furniture_score(objects, furnitures, dist_max, is_daylight, is_privacy):
    max_score = 100 / len(objects)
    interval_dist = []
    interval_dist_reverse = []
    interval_score = rh.Interval(0, max_score)
    for i in range(len(objects)):
        interval_dist.append(rh.Interval(0, dist_max[i]))
        interval_dist_reverse.append(rh.Interval(dist_max[i], 0))
    
    if is_daylight:
        for furniture in furnitures:
            daylight_score = 0
            for i, dist in enumerate(furniture.dist_to_window):
                if furniture.name == 'bed' or furniture.name == 'lounge':
                    daylight_score += remap(dist, interval_dist[i], interval_score)
                elif furniture.name == 'desk':
                    daylight_score += remap(dist, interval_dist_reverse[i], interval_score)
            furniture.daylight_score = daylight_score
            
    if is_privacy:
        for furniture in furnitures:
            privacy_score = 0
            for i, dist in enumerate(furniture.dist_to_door):
                if furniture.name == 'bed' or furniture.name == 'desk':
                    privacy_score += remap(dist, interval_dist[i], interval_score)
                elif furniture.name == 'lounge':
                    privacy_score += remap(dist, interval_dist_reverse[i], interval_score)
            furniture.privacy_score = privacy_score

# Define furniture classes
# Bed: Longer distance from window -> Higher score
class Bed:
    name = 'bed'
    def __init__(self, body, source, target):
        self.body = body.Duplicate()
        orient(self.body, source, target)
        self.buffer = get_buffer(self.body, True)
        self.daylight_score = None
        self.privacy_score = None
        self.dist_to_window = []
        self.dist_to_door = []
    
# Lounge: Shorter distance from the window -> Higher score
class Lounge:
    name = 'lounge'
    def __init__(self, body, source, target):
        self.body = body.Duplicate()
        orient(self.body, source, target)
        self.buffer = get_buffer(self.body, True)
        self.daylight_score = None
        self.privacy_score = None
        self.dist_to_window = []
        self.dist_to_door = []
        
# Desk: Shorter distance from the window -> Higher score
class Desk:
    name = 'desk'
    def __init__(self, body, source, target):
        self.body = body.Duplicate()
        orient(self.body, source, target)
        self.buffer = get_buffer(self.body, False)
        self.daylight_score = None
        self.privacy_score = None
        self.dist_to_window = []
        self.dist_to_door = []


# Create furniture instances
bed_anchors = get_anchors(i_bed, True, False)
lounge_anchors = get_anchors(i_lounge, True, False)
desk_anchors = get_anchors(i_desk, True, False)
beds = []
lounges = []
desks = []
furnitures = []

for target in i_targets:
    for anchor in bed_anchors:
        bed = Bed(i_bed, anchor, target)
        beds.append(bed)
        furnitures.append(bed)
    for anchor in lounge_anchors:
        lounge = Lounge(i_lounge, anchor, target)
        lounges.append(lounge)
        furnitures.append(lounge)
    for anchor in desk_anchors:
        desk = Desk(i_desk, anchor, target)
        desks.append(desk)
        furnitures.append(desk)

# Set distance between furniture and windows
dist_max_wins =  set_dist_to_objects(i_wins, furnitures, True)
dist_max_doors = set_dist_to_objects(i_doors, furnitures, False)

# Compute daylight/privacy scores for furniture instances
set_furniture_score(i_wins, furnitures, dist_max_wins, True, False)
set_furniture_score(i_doors, furnitures, dist_max_doors, False, True)


# Outputs
o_furniture = [beds, lounges, desks]
o_bed_anchors = bed_anchors
o_lounge_anchors = lounge_anchors
o_desk_anchors = desk_anchors
# ---------- end furniture_instances ----------
furnitrue_combinations = GhPythonScript(i_furniture=furniture_instances.o_furniture)  # -> out, o_combinations; inputs i_furniture: list
# ---------- furnitrue_combinations: Python ----------
import Rhino.Geometry as rh

# Functions
def get_combination_counts(lists):
    n = 1
    for list in lists:
        n *= len(list)
    return n

def cross_reference(lists, n):
    divisor = 1
    cross_refs = []
    for list in lists:
        cross_ref = []
        for i in range(n):
            index = (i // divisor) % len(list)
            cross_ref.append(list[index])
        cross_refs.append(cross_ref)
        divisor *= len(list)
    return cross_refs

def generate_combinations(cross_refs, n):
    combinations = []
    for i in range(n):
        combination = []
        for cross_ref in cross_refs:
            combination.append(cross_ref[i])
        combinations.append(combination)
    return combinations


# CrossReference(holistic) every element
combination_counts = get_combination_counts(i_furniture) 
cross_refs = cross_reference(i_furniture, combination_counts)
combinations = generate_combinations(cross_refs, combination_counts)


# Outputs
o_combinations = combinations
# ---------- end furnitrue_combinations ----------

# ----
# Filter Combinations in Collision
collision_detection = GhPythonScript(i_floor=floor, i_door=door_buffer, i_wins=win, i_combinations=furnitrue_combinations.o_combinations)  # -> out, o_combinations, o_count; inputs i_floor: Curve, i_door: Curve, i_wins: list of Curve, i_combinations: list
# ---------- collision_detection: Python ----------
import Rhino.RhinoDoc
import Rhino.Geometry as rh
tol = Rhino.RhinoDoc.ActiveDoc.ModelAbsoluteTolerance

# Functions
def get_vertices(curves):
    vertices = []
    for curve in curves:
        segments = curve.DuplicateSegments()
        for seg in segments:
            vertices.append(seg.PointAtStart)
    return vertices
    
def get_vertices_middle(curves):
    vertices = []
    for curve in curves:
        segments = curve.DuplicateSegments()
        for seg in segments:
            len = seg.GetLength()
            mid = seg.PointAtLength(len / 2)
            vertices.append(seg.PointAtStart)
            vertices.append(mid)
    return vertices

def inside_floor(curve):
    pts = get_vertices([curve])
    for pt in pts:
        containment = int(i_floor.Contains(pt, rh.Plane.WorldXY, tol))
        if containment == 2:
            return False
    return True

def contain_pts(curve, pts):
    for pt in pts:
        containment = int(curve.Contains(pt, rh.Plane.WorldXY, tol))
        if containment == 1:
            return True
    return False


# Collision Detection:
# pointContainment(unset = 0, inside = 1, outside = 2, coincident = 3)
combinations_filter = []
for combination in i_combinations:
    
    # Wall Collision:
    wall_collision = False
    for furniture in combination:
        # check if Furniture vertices outside floor plan
        if not inside_floor(furniture.body):
            wall_collision = True
            break
        # check if Buffer vertices outside floor plan
        valid_buffer = 0
        for i in reversed(range(len(furniture.buffer))):
            inside = inside_floor(furniture.buffer[i])
            if inside: valid_buffer += 1
            else: furniture.buffer.pop(i)
        if valid_buffer == 0: wall_collision = True
    if wall_collision:
        continue
    
    # Furniture Collision: 
    furniture_collision = False
    obstacles = [] # add i_door to obstacles list
    obstacles_buffers = [] # add i_door to obstacles_buffers list
    for furniture in combination:
        obstacles.append(furniture.body)
        obstacles_buffers.append(furniture.buffer)
    obstacles.append(i_door)
    obstacles_buffers.append([i_door])
    pts_with_mid = get_vertices_middle(obstacles) 
    
    # check if Furnitures collide each other
    for obstacle in obstacles:
        for pt in pts_with_mid:
            containment = int(obstacle.Contains(pt, rh.Plane.WorldXY, tol))
            if containment == 1:
                furniture_collision = True
                break        
    
    # check if Buffers collide with Furnitures
    for furniture_buffers in obstacles_buffers:
        for i, buffer in enumerate(furniture_buffers):
            containment = contain_pts(buffer, pts_with_mid)
            if not containment:
                break
            elif i == len(furniture_buffers) - 1:
                furniture_collision = True
    if furniture_collision:
        continue
        
    # check if Lounges collide with Windows
    lounge_window_collision = False
    pts = get_vertices(i_wins)
    for furniture in combination:
        if furniture.name == 'lounge':
            for pt in pts:
                containment = int(furniture.body.Contains(pt, rh.Plane.WorldXY, tol))
                if containment == 1 or containment == 3:
                    lounge_window_collision = True
                    break
    if lounge_window_collision:
        continue

    # Furniture Combinations with no Collisions
    combinations_filter.append(combination)


# Ouputs
o_combinations = combinations_filter
o_count = len(combinations_filter)
# ---------- end collision_detection ----------
visualize = GhPythonScript(i_combinations=collision_detection.o_combinations, index=Slider(0, range=0..33))  # -> out, o_bodies, o_buffers; inputs i_combinations: list, index: Int32
# ---------- visualize: Python ----------
import Rhino.Geometry as rh

# Visualize funiture combinations
combinations_bodies = []
combinations_buffers = []
for combination in i_combinations:
    bodies = []
    buffers = []
    for furniture in combination:
        bodies.append(furniture.body)
        for buffer in furniture.buffer:
            buffers.append(buffer)
    combinations_bodies.append(bodies)
    combinations_buffers.append(buffers)

# Outputs
o_bodies = combinations_bodies[index]
o_buffers = combinations_buffers[index]
# ---------- end visualize ----------
o_count = Panel(collision_detection.o_count)
preview = CustomPreview(Geometry=visualize.o_bodies, Material=ColourSwatch(SwatchColor=RGB(255, 255, 255)))

# ----
# Recommend Combinations
# with High Scores
panel_3 = Panel("10")
recommend_combinations = GhPythonScript(
    i_floor=floor,
    i_combinations=collision_detection.o_combinations,
    i_counts=panel_3,
    i_daylight_weight="1.0",
    i_privacy_weight="0.5",
    i_circulation_weight="1.0",
    i_min_width="30")  # -> out, o_combinations, a, b, o_circulation; inputs i_floor: Curve, i_combinations: list, i_counts: Int32
# ---------- recommend_combinations: Python ----------
import Rhino.Geometry as rh
import Rhino.Collections 
import math
tol = Rhino.RhinoDoc.ActiveDoc.ModelAbsoluteTolerance
max_dist = 500 # max searching distance for 'ClosestPoint' function

# Function
def project_pt(pt, direction, curve):
    line = rh.Line(pt, pt + direction)
    intersections = rh.Intersect.Intersection.CurveLine(curve, line, tol, tol)
    shortest = float('inf')
    closest_pt = rh.Point3d.Unset
    for inter in intersections:
        dist = inter.PointA.DistanceToSquared(pt)
        if dist < shortest: closest_pt = inter.PointA
    return closest_pt

def get_middle(curve):
    half = curve.GetLength() / 2
    pt = curve.PointAtLength(half)
    t = curve.LengthParameter(half)[1]
    return (pt, t)
    
def contain_pt(curve, pt):
    # containment(unset = 0, inside = 1, outside = 2, coincident = 3)
    containment = int(curve.Contains(pt, rh.Plane.WorldXY, tol))
    if containment == 1 or containment == 3: return True
    elif containment == 2: return False
    else: print('contain_pt: point containment unset')

def get_normals_inwards(curve):
    transforms = []
    segments = curve.DuplicateSegments()
    for seg in segments:
        mid = get_middle(seg) # mid(pt, t)
        vec = seg.TangentAt(mid[1])
        vec.Rotate(math.pi / 2, rh.Vector3d(0, 0, 1))
        if contain_pt(curve, mid[0] + vec * tol * 10): transforms.append(vec)
        else: transforms.append(-vec)
    return transforms

def crv_closest_pts(pts, crv, max_dist):
    closest_pts = []
    parameters = []
    dists = []
    for pt in pts:
        parameters.append(crv.ClosestPoint(pt, max_dist)[1])
    for t in parameters:
        closest_pts.append(crv.PointAt(t))
    for i, cp in enumerate(closest_pts):
        dists.append(cp.DistanceTo(pts[i]))
    return (closest_pts, parameters, dists)

def get_circulation_crv(combination, floor, n = 0): 
    # base case for recursion
    if n >= len(combination):
        return floor
    
    furniture = combination[n]
    circulation_segs = []
    furniture_pts = []
    furniture_pts_conincident = []
    floor_parameters= []
    furniture_segs = furniture.body.DuplicateSegments()
    for seg in furniture_segs:
        furniture_pts.append(seg.PointAtStart)
        
    floor_cp = crv_closest_pts(furniture_pts, floor, max_dist) # pts, parameters, dists
    for i in range(len(floor_cp[0])):
        p = floor_cp[0][i]
        t = floor_cp[1][i]
        d = floor_cp[2][i]
        if d < tol:
            floor_parameters.append(t)
            furniture_pts_conincident.append(p)
    floor_segs = floor.Split(floor_parameters)
    for seg in floor_segs:
        if len(seg.DuplicateSegments()) > 1:
            circulation_segs.append(seg)
    
    furniture_parameters = crv_closest_pts(furniture_pts_conincident, furniture.body, max_dist)[1]
    furniture_segs = furniture.body.Split(furniture_parameters)
    for seg in furniture_segs:
        if len(seg.DuplicateSegments()) > 1:
            circulation_segs.append(seg)
    
    floor_new = rh.Curve.JoinCurves(circulation_segs)[0]
    return get_circulation_crv(combination, floor_new, n + 1)

def remove_invalid_paths(circulation, min_width, both_ends = True): # recursion for both_ends
    transforms = get_normals_inwards(circulation)
    segments = circulation.DuplicateSegments()
    invalid_paths = []
    if both_ends:
        for i, seg in enumerate(segments):
            # test if both transformed points are outside of circulation curve
            pt_start = seg.PointAtStart
            pt_end = seg.PointAtEnd
            pt_start_xform = pt_start + (transforms[i] * min_width)
            pt_end_xform = pt_end + (transforms[i] * min_width)
            pt_start_outside = not contain_pt(circulation, pt_start_xform)
            pt_end_outside = not contain_pt(circulation, pt_end_xform)
            if pt_start_outside and pt_end_outside:
                pt_start_proj = project_pt(pt_start, transforms[i], circulation)
                pt_end_proj = project_pt(pt_end, transforms[i], circulation)
                print(pt_start_proj)
                print(pt_end_proj)
                invalid_path = rh.NurbsCurve.Create(True, 1, [pt_start, pt_start_proj, pt_end_proj, pt_end])
                invalid_paths.append(invalid_path)

    return invalid_paths
    
# Get circulation geometry for each combination
circulation_crvs = []
for combination in i_combinations:
    circulation_crvs.append(get_circulation_crv(combination, i_floor))

# Find circulation geometry segments with collision on both ends
index = 0
a = remove_invalid_paths(circulation_crvs[index], i_min_width)
o_circulation = circulation_crvs[index]

# Recommend combinations:
# Compute daylight/privacy total scores
total_scores = []
for combination in i_combinations:
    total_score = 0
    for furniture in combination:
        total_score += (furniture.daylight_score * i_daylight_weight)
        total_score += (furniture.privacy_score * i_privacy_weight)
    total_scores.append(total_score)

# Sort combinations to filter high performing options
total_scores_sorted = sorted(total_scores, reverse=True)
combinations_index = [(i, c) for i, c in enumerate(i_combinations)]
combinations_sorted = sorted(combinations_index, key = lambda x : total_scores[x[0]], reverse=True)
combinations_selected = []
for i in range(i_counts):
    combinations_selected.append(combinations_sorted[i][1])


# Outputs
for i, combination in enumerate(combinations_selected):
    for furniture in combination:
        daylight_score = furniture.daylight_score * i_daylight_weight
        privacy_score = furniture.privacy_score * i_privacy_weight
        if furniture.name == 'bed':
            bed_string = 'bed(light:{:.2f} privacy:{:.2f})'.format(daylight_score, privacy_score)
        elif furniture.name == 'lounge':
            lounge_string = 'lounge(light:{:.2f} privacy:{:.2f})'.format(daylight_score, privacy_score)
        elif furniture.name == 'desk':
            desk_string = 'desk(light:{:.2f} privacy:{:.2f}'.format(daylight_score, privacy_score)
    total_string = 'total: {:.2f}'.format(total_scores_sorted[i])
    print(bed_string, lounge_string, desk_string, total_string)
    
o_combinations = combinations_selected
# ---------- end recommend_combinations ----------
panel_4 = Panel(recommend_combinations.out)
visualize_2 = GhPythonScript(i_combinations=recommend_combinations.o_combinations, index=Slider(5, range=0..9))  # -> out, o_bodies, o_buffers; inputs i_combinations: list, index: Int32; same code as visualize
preview_2 = CustomPreview(Geometry=visualize_2.o_bodies, Material=ColourSwatch(SwatchColor=RGB(255, 255, 255)))

recommend_combinations_2 = GhPythonScript(
    i_floor=floor,
    i_combinations=collision_detection.o_combinations,
    i_counts=panel_3,
    i_daylight_weight="1.0",
    i_privacy_weight="0.5",
    i_circulation_weight="1.0",
    i_min_width="30")  # -> out, o_combinations, a, b, o_circulation; inputs i_floor: Curve, i_combinations: list, i_counts: Int32
# ---------- recommend_combinations_2: Python ----------
import Rhino.Geometry as rh
import Rhino.Collections 
import math
tol = Rhino.RhinoDoc.ActiveDoc.ModelAbsoluteTolerance
max_dist = 500 # max searching distance for 'ClosestPoint' function

# Function
def get_middle(curve):
    half = curve.GetLength() / 2
    pt = curve.PointAtLength(half)
    t = curve.LengthParameter(half)[1]
    return (pt, t)
    
def contain_pt(curve, pt):
    # containment(unset = 0, inside = 1, outside = 2, coincident = 3)
    containment = int(curve.Contains(pt, rh.Plane.WorldXY, tol))
    if containment == 1 or containment == 3: return True
    elif containment == 2: return False
    else: print('contain_pt: point containment unset')

def get_normals_inwards(curve):
    transforms = []
    segments = curve.DuplicateSegments()
    for seg in segments:
        mid = get_middle(seg) # mid(pt, t)
        vec = seg.TangentAt(mid[1])
        vec.Rotate(math.pi / 2, rh.Vector3d(0, 0, 1))
        if contain_pt(curve, mid[0] + vec * tol): transforms.append(vec)
        else: transforms.append(- vec)
    return transforms

def crv_closest_pts(pts, crv, max_dist):
    closest_pts = []
    parameters = []
    dists = []
    for pt in pts:
        parameters.append(crv.ClosestPoint(pt, max_dist)[1])
    for t in parameters:
        closest_pts.append(crv.PointAt(t))
    for i, cp in enumerate(closest_pts):
        dists.append(cp.DistanceTo(pts[i]))
    return (closest_pts, parameters, dists)

def get_circulation_crv(combination, floor, n = 0): 
    # base case for recursion
    if n >= len(combination):
        return floor
    
    furniture = combination[n]
    circulation_segs = []
    furniture_pts = []
    furniture_pts_conincident = []
    floor_parameters= []
    furniture_segs = furniture.body.DuplicateSegments()
    for seg in furniture_segs:
        furniture_pts.append(seg.PointAtStart)
        
    floor_cp = crv_closest_pts(furniture_pts, floor, max_dist) # pts, parameters, dists
    for i in range(len(floor_cp[0])):
        p = floor_cp[0][i]
        t = floor_cp[1][i]
        d = floor_cp[2][i]
        if d < tol:
            floor_parameters.append(t)
            furniture_pts_conincident.append(p)
    floor_segs = floor.Split(floor_parameters)
    for seg in floor_segs:
        if len(seg.DuplicateSegments()) > 1:
            circulation_segs.append(seg)
    
    furniture_parameters = crv_closest_pts(furniture_pts_conincident, furniture.body, max_dist)[1]
    furniture_segs = furniture.body.Split(furniture_parameters)
    for seg in furniture_segs:
        if len(seg.DuplicateSegments()) > 1:
            circulation_segs.append(seg)
    
    floor_new = rh.Curve.JoinCurves(circulation_segs)[0]
    return get_circulation_crv(combination, floor_new, n + 1)

def get_invalid_paths(circulation, min_width, both_ends):
    transforms = get_normals_inwards(circulation)
    segments = circulation.DuplicateSegments()
    invalid_paths = []
    for i, seg in enumerate(segments):
        pt_start = seg.PointAtStart
        pt_end = seg.PointAtEnd
        
        if both_ends:
            pt_start_xform = pt_start + (transforms[i] * min_width)
            pt_end_xform = pt_end + (transforms[i] * min_width)
            pt_start_outside = not contain_pt(circulation, pt_start_xform)
            pt_end_outside = not contain_pt(circulation, pt_end_xform)
            if pt_start_outside and pt_end_outside:
                invalid_paths.append((pt_start, pt_end, transforms[i]))

    return invalid_paths
    
# Get circulation geometry for each combination
circulation_crvs = []
for combination in i_combinations:
    circulation_crvs.append(get_circulation_crv(combination, i_floor))

# Find circulation geometry segments with collision on both ends
#transforms = get_normals_inwards(circulation_crvs[0])
segments = circulation_crvs[0].DuplicateSegments()
index = 0


mid = get_middle(segments[index]) # mid(pt, t)
vec = segments[index].TangentAt(mid[1])
vec.Rotate(math.pi / 2, rh.Vector3d(0, 0, 1))
if contain_pt(circulation_crvs[0], mid[0] + vec * 0.5): 
    transform = vec
else: 
    transform = -vec


a = mid[0]
b = mid[0] + vec * 0.5


pt_start = segments[index].PointAtStart
pt_end = segments[index].PointAtEnd
pt_start_xform = pt_start + (transform * i_min_width)
pt_end_xform = pt_end + (transform * i_min_width)
o_geo = rh.Line(pt_start_xform, pt_end_xform)
pt_start_outside = not contain_pt(circulation_crvs[0], pt_start_xform)
pt_end_outside = not contain_pt(circulation_crvs[0], pt_end_xform)
a = pt_start_outside and pt_end_outside
b = segments[index]


#a = get_invalid_paths(circulation_crvs[0], i_min_width, True)
o_circulation = circulation_crvs[0]

# Recommend combinations:
# Compute daylight/privacy total scores
total_scores = []
for combination in i_combinations:
    total_score = 0
    for furniture in combination:
        total_score += (furniture.daylight_score * i_daylight_weight)
        total_score += (furniture.privacy_score * i_privacy_weight)
    total_scores.append(total_score)

# Sort combinations to filter high performing options
total_scores_sorted = sorted(total_scores, reverse=True)
combinations_index = [(i, c) for i, c in enumerate(i_combinations)]
combinations_sorted = sorted(combinations_index, key = lambda x : total_scores[x[0]], reverse=True)
combinations_selected = []
for i in range(i_counts):
    combinations_selected.append(combinations_sorted[i][1])


# Outputs
for i, combination in enumerate(combinations_selected):
    for furniture in combination:
        daylight_score = furniture.daylight_score * i_daylight_weight
        privacy_score = furniture.privacy_score * i_privacy_weight
        if furniture.name == 'bed':
            bed_string = 'bed(light:{:.2f} privacy:{:.2f})'.format(daylight_score, privacy_score)
        elif furniture.name == 'lounge':
            lounge_string = 'lounge(light:{:.2f} privacy:{:.2f})'.format(daylight_score, privacy_score)
        elif furniture.name == 'desk':
            desk_string = 'desk(light:{:.2f} privacy:{:.2f}'.format(daylight_score, privacy_score)
    total_string = 'total: {:.2f}'.format(total_scores_sorted[i])
    print(bed_string, lounge_string, desk_string, total_string)
    
o_combinations = combinations_selected
# ---------- end recommend_combinations_2 ----------
geo = Geometry(recommend_combinations_2.b)
geo_2 = Geometry(recommend_combinations.b)
panel_5 = Panel(recommend_combinations_2.a)
geo_3 = Geometry(recommend_combinations.a)
circulation = Geometry(recommend_combinations.o_circulation)
item = ListItem(List=geo_3, Index=Slider(1, range=0..1), Wrap=True)
item_2 = ListItem(List=panel_4, Index=Slider(3, range=0..3), Wrap=True)
pt = Point(item_2)
